# Grasshopper definition SyncSender_TaskCapable.gh (Grasshopper 1.0.7)
# Copyright: Arup
# plug-ins: Speckle (CX)

arup_uk_sp_stamatios = Accounts(email="stamatios.psarras@arup.com", restapi="https://uk.speckle.arup.com/api")

# ---- group: Make Sure this Exists
panel = Panel("8vLlZfYG9")

# ----
projects = Projects(Account=arup_uk_sp_stamatios)  # -> Projects, SelectedProject
item = ListItem(List=projects.Projects, Index=0, Wrap=True)
dss = DataSenderSync(Account=arup_uk_sp_stamatios, StreamId=panel, Project=item, A=Slider(10, range=0..10))
python = GhPythonScript(x=panel, y=dss)  # -> out, a
# ---------- python: Python ----------
__author__ = "Stamatios.Psarras"
__version__ = "2021.02.23"

import rhinoscriptsyntax as rs

a = x
# ---------- end python ----------
drs = DataReceiverSync(Account=arup_uk_sp_stamatios, Stream=python.a)
dsr = Deserialiser(Object=drs)
panel_2 = Panel(dsr)
